# Grasshopper definition 3D Points New Size.gh (Grasshopper 0.9.76)

number_slider = Slider(24, range=0..50)
number_slider_2 = Slider(1220, range=0..1220)
number_slider_3 = Slider(46, range=40..70)
number_slider_4 = Slider(1220, range=0..1220)
number_slider_5 = Slider(2400, range=0..2440)
range = Range(Domain=number_slider_2, Steps=number_slider)
range_2 = Range(Domain=number_slider_5, Steps=number_slider_3)
range_3 = Range(Domain=number_slider_4, Steps=number_slider)
rectangle = Rectangle(Plane=PlaneXY(0, 0, 0), XSize=number_slider_4, YSize=number_slider_2, Radius=0)  # -> Rectangle, Length
dispatch = Dispatch(List=range_3, DispatchPattern=[True, False])  # -> ListA, ListB
item = ListItem(List=range_2, Index=1, Wrap=True)
dispatch_2 = Dispatch(List=range_2, DispatchPattern=[True, False])  # -> ListA, ListB
item_2 = ListItem(List=range_3, Index=1, Wrap=True)
dispatch_3 = Dispatch(List=range, DispatchPattern=[True, False])  # -> ListA, ListB
boxrec = BoxRectangle(Rectangle=rectangle.Rectangle, Height=number_slider_5)
pt = ConstructPoint(XCoordinate=dispatch.ListB, YCoordinate=0, ZCoordinate=0)
panel = Panel(item)
panel_2 = Panel(item_2)
wires = BrepWireframe(Brep=boxrec, Density=-1)
pt_2 = Point(pt)
Y = UnitY(Factor=dispatch_3.ListB)
move = Move(Geometry=graft(pt_2), Motion=Y)  # -> Geometry, Transform
Z = UnitZ(Factor=dispatch_2.ListB)
move_2 = Move(Geometry=graft(move.Geometry), Motion=Z)  # -> Geometry, Transform
flatten = FlattenTree(Tree=move_2.Geometry, Path="{0}")
item_3 = ListItem(List=move_2.Geometry, Index=0, Wrap=True)  # -> simplify(Item)
points = PointList(Points=move_2.Geometry)
lng = ListLength(List=flatten)
num = Number(3)
trim = TrimTree(Tree=item_3, Depth=1)
expression = Expression(x=lng, y=num, Expression="x*y")
points_2 = PointList(Points=trim)
expression_2 = Expression(x=expression, y="10000", Expression="abs(x-y)")
galapagos = Galapagos(fitness=expression_2, gene=[number_slider_3, number_slider])
panel_3 = Panel(lng)
